# Grasshopper definition 03_11_25_curves_exported.gh (Grasshopper 1.0.8)
# plug-ins: DigitalCircularityToolkit

mesh = Mesh([<mesh referenced from the Rhino model> x8])
boxobj = BoxObjectDCT(Geometry=mesh, NumSamples=50, Quantity=1, LengthBuffer=1, WidthBuffer=1, HeightBuffer=1, ID="NoID")  # -> BoxObject, EffectiveBox
path = FilePath("/Users/r2d2/Desktop/RockStacking/rock_placements.csv")
objprops = ObjectPropertiesDCT(Object=boxobj.BoxObject)  # -> Centroid, PCA1, PCA2, PCA3, Length, Width, Height, BoundingBox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
py3 = Python3Script(plotted_path=path)  # -> out, x, y, angle; inputs plotted_path: String
# ---------- py3: Python ----------
#! python3
# requirements: pandas
import numpy as np
import pandas as pd

df = pd.read_csv(plotted_path)

x = []
y = []
angle = []

for index, row in df.iterrows():
    x.append(row["x"])
    y.append(row["y"])
    angle.append(row["angle"])
# ---------- end py3 ----------
xy = XYPlane(Origin=Point(0, 0, 0))
pln = Plane(objprops.LocalPlane)
planaroutline = PlanarOutlineDCT(Object=boxobj.BoxObject)
pt = ConstructPoint(XCoordinate=py3.x, YCoordinate=py3.y, ZCoordinate=0)
rad = Radians(Degrees=py3.angle)
orient = Orient(Geometry=planaroutline, Source=pln, Target=PlaneXY(0, 0, 0))  # -> Geometry, Transform
move = Move(Geometry=xy, Motion=pt)  # -> Geometry, Transform

# ---- group: Automatic
len = Length(Curve=orient.Geometry)
dom = ConstructDomain(DomainStart=0, DomainEnd=len)

# ----
rotate = Rotate(Geometry=move.Geometry, Angle=rad, Plane=pt)  # -> Geometry, Transform
orient_2 = Orient(Geometry=mesh, Source=pln, Target=rotate.Geometry)  # -> Geometry, Transform
crvdom = CurveDomain(Curve=orient.Geometry, Domain=dom)  # -> Curve, Domain
path_2 = FilePath("/Users/r2d2/Desktop/RockStacking/data_rocks.csv")
crv = Curve(crvdom.Curve)
py3_2 = Python3Script(curves=crv, path=path_2)  # -> out, a; inputs curves: list of Curve, path: String
# ---------- py3_2: Python ----------
#! python3
# requirements: pandas
import numpy as np
import pandas as pd

params = np.linspace(0, 1, 25)

data_keys = {"rock_id":[], "profile":[]}
a = []
for index, curve in enumerate(curves):
    # get curve length 
    pts = []
    for i in range(len(params) - 1):
        pt = curve.PointAt(params[i] * curve.GetLength())
        x, y = pt.X, pt.Y
        pts.append([x, y])
        a.append(pt)
    data_keys["rock_id"].append(index)
    data_keys["profile"].append(pts)

df = pd.DataFrame.from_dict(data_keys)
df.to_csv(path, index=False)
# ---------- end py3_2 ----------
domain = Domain(crv)
